% Requirement links of BMS_Software.slx (R2024b)

model implements BMS_Requirements.slreqx#24: 3 BMS Architecture and module specifications: BMS Architecture and module specifications
model implements BMS_Requirements.slreqx#2: 1 Overview: Overview
model implements BMS_Requirements.slreqx#3: 2 BMS Interfaces: BMS Interfaces
model implements BMS_Requirements.slreqx#4: 2.1 BMS Inputs: BMS Inputs
model implements BMS_Requirements.slreqx#12: 2.2 BMS Outputs: BMS Outputs
block :152 implements BMS_Requirements.slreqx#11: 2.1.7 StateRequest: StateRequest
block :258 implements BMS_Requirements.slreqx#42: 3.3 BMS – SOC Estimation: BMS – SOC Estimation
block :259 implements BMS_Requirements.slreqx#37: 3.2 BMS – Current Limit Calculation: BMS – Current Limit Calculation
block :260 implements BMS_Requirements.slreqx#25: 3.1 BMS - Main State Machine: BMS - Main State Machine
block :273 implements BMS_Requirements.slreqx#460: 2.2.3 Current Limits: Current Limits
block :273 implements BMS_Requirements.slreqx#461: 2.2.4 BalCmd: BalCmd
block :273 implements BMS_Requirements.slreqx#462: 2.2.5 ChargeCurrentReq: ChargeCurrentReq
block :283 implements BMS_Requirements.slreqx#5: 2.1.1 Cell_Voltages: Cell_Voltages
block :283 implements BMS_Requirements.slreqx#6: 2.1.2 Cell_Temperatures: Cell_Temperatures
block :283 implements BMS_Requirements.slreqx#7: 2.1.3 Pack_Current: Pack_Current
block :283 implements BMS_Requirements.slreqx#8: 2.1.4 Pack_Voltage: Pack_Voltage
block :283 implements BMS_Requirements.slreqx#9: 2.1.5 Vout_Chgr: Vout_Chgr
block :283 implements BMS_Requirements.slreqx#10: 2.1.6 Vout_Invtr: Vout_Invtr
block :294 implements BMS_Requirements.slreqx#458: 2.2.1 SOC: SOC
block :294 implements BMS_Requirements.slreqx#459: 2.2.2 BMS_State: BMS_State
block :303 implements BMS_Requirements.slreqx#463: 2.2.6 PosContactorChgrCmd (: PosContactorChgrCmd (
block :303 implements BMS_Requirements.slreqx#464: 2.2.7 PreChargeRelayChgrCmd: PreChargeRelayChgrCmd
block :303 implements BMS_Requirements.slreqx#465: 2.2.8 NegContactorChgrCmd: NegContactorChgrCmd
block :303 implements BMS_Requirements.slreqx#466: 2.2.9 PosContactorInvtrCmd: PosContactorInvtrCmd
block :303 implements BMS_Requirements.slreqx#467: 2.2.10 PreChargeRelayInvtrCmd: PreChargeRelayInvtrCmd
block :303 implements BMS_Requirements.slreqx#468: 2.2.11 NegContactorInvtrCmd: NegContactorInvtrCmd
block :335 implements BMS_Requirements.slreqx#460: 2.2.3 Current Limits: Current Limits
block :335 implements BMS_Requirements.slreqx#461: 2.2.4 BalCmd: BalCmd
block :335 implements BMS_Requirements.slreqx#462: 2.2.5 ChargeCurrentReq: ChargeCurrentReq
block :615 implements BMS_Requirements.slreqx#41: 3.2.4 BMS Current Limit Calculation: C: BMS Current Limit Calculation: Charge Current Limit
block :622 implements BMS_Requirements.slreqx#296: 3.2.3 BMS Current Limit Calculation: D: BMS Current Limit Calculation: Discharge Current Limit
block :651 implements BMS_Requirements.slreqx#11: 2.1.7 StateRequest: StateRequest