% Requirement links of FltDiagLmt.slx (R2024b)

model implements BMS_Requirements.slreqx#38: 3.2.1 BMS Current Limit Calculation: Interfaces: BMS Current Limit Calculation: Interfaces
model implements BMS_Requirements.slreqx#39: 3.2.1.1 Inputs: Inputs
model implements BMS_Requirements.slreqx#40: 3.2.1.2 Outputs: Outputs
model implements BMS_Requirements.slreqx#37: 3.2 BMS – Current Limit Calculation: BMS – Current Limit Calculation
block :104 implements BMS_Requirements.slreqx#41: 3.2.4 BMS Current Limit Calculation: C: BMS Current Limit Calculation: Charge Current Limit
block :111 implements BMS_Requirements.slreqx#296: 3.2.3 BMS Current Limit Calculation: D: BMS Current Limit Calculation: Discharge Current Limit
block :142 implements BMS_Requirements.slreqx#296: 3.2.3 BMS Current Limit Calculation: D: BMS Current Limit Calculation: Discharge Current Limit
block :38 implements BMS_Requirements.slreqx#41: 3.2.4 BMS Current Limit Calculation: C: BMS Current Limit Calculation: Charge Current Limit
block :41 implements BMS_Requirements.slreqx#296: 3.2.3 BMS Current Limit Calculation: D: BMS Current Limit Calculation: Discharge Current Limit
block :44 implements BMS_Requirements.slreqx#295: 3.2.2 BMS Current Limit Calculation: Min/Max Calculation: BMS Current Limit Calculation: Min/Max Calculation
block :56 implements BMS_Requirements.slreqx#296: 3.2.3 BMS Current Limit Calculation: D: BMS Current Limit Calculation: Discharge Current Limit
block :68 implements BMS_Requirements.slreqx#296: 3.2.3 BMS Current Limit Calculation: D: BMS Current Limit Calculation: Discharge Current Limit
block :89 implements BMS_Requirements.slreqx#295: 3.2.2 BMS Current Limit Calculation: Min/Max Calculation: BMS Current Limit Calculation: Min/Max Calculation