% Requirement links of SOC_Estimation.slx (R2024b)

model implements BMS_Requirements.slreqx#43: 3.3.1 BMS SOC Estimation: Interfaces: BMS SOC Estimation: Interfaces
model implements BMS_Requirements.slreqx#44: 3.3.1.1 Inputs: Inputs
model implements BMS_Requirements.slreqx#45: 3.3.1.2 Outputs: Outputs
model implements BMS_Requirements.slreqx#42: 3.3 BMS – SOC Estimation: BMS – SOC Estimation
block :100 implements BMS_Requirements.slreqx#248: 3.3.4 BMS Current Limit Calculation: SOC EKF: BMS Current Limit Calculation: SOC EKF
block :135 implements BMS_Requirements.slreqx#247: 3.3.3 BMS Current Limit Calculation: SOC UKF: BMS Current Limit Calculation: SOC UKF
block :197 implements BMS_Requirements.slreqx#248: 3.3.4 BMS Current Limit Calculation: SOC EKF: BMS Current Limit Calculation: SOC EKF
block :226 implements BMS_Requirements.slreqx#247: 3.3.3 BMS Current Limit Calculation: SOC UKF: BMS Current Limit Calculation: SOC UKF
block :25 implements BMS_Requirements.slreqx#246: 3.3.2 BMS Current Limit Calculation: Coulomb Counting: BMS Current Limit Calculation: Coulomb Counting
block :291 implements BMS_Requirements.slreqx#246: 3.3.2 BMS Current Limit Calculation: Coulomb Counting: BMS Current Limit Calculation: Coulomb Counting
block :390 implements BMS_Requirements.slreqx#246: 3.3.2 BMS Current Limit Calculation: Coulomb Counting: BMS Current Limit Calculation: Coulomb Counting
block :535 implements BMS_Requirements.slreqx#246: 3.3.2 BMS Current Limit Calculation: Coulomb Counting: BMS Current Limit Calculation: Coulomb Counting
block :75 implements BMS_Requirements.slreqx#248: 3.3.4 BMS Current Limit Calculation: SOC EKF: BMS Current Limit Calculation: SOC EKF
block :82 implements BMS_Requirements.slreqx#247: 3.3.3 BMS Current Limit Calculation: SOC UKF: BMS Current Limit Calculation: SOC UKF