% Simulink data dictionary Shared_DD.sldd
% references Battery_1Pack_1RC.sldd

OverCellVoltageLimit = single(4.4)
UnderCellVoltageLimit = single(2.5)
ts = 0.1

SRE = enum(DefaultValue="Balancing", StorageType="int8")
  Balancing = 0
  Charging = 1
  Driving = 2

Faults = Simulink.Bus()
  VoltSensor: boolean
  OverCurrent: boolean
  HighTemp: boolean
  LowTemp: boolean
  OverVolt: boolean
  UnderVolt: boolean
  Charger: boolean
  Inverter: boolean

TestCase = 1
OverCurDisLmt = single(180)

Battery_Info = Simulink.Bus()
  Pack_Current: single
  Cell_Voltages: single[6]
  MinCellVolt: single
  MaxCellVolt: single
  ChargeCurrentLimit: single
  DisChargeCurrentLimit: single
  Cell_Temperatures: single[6]
  Pack_Voltage: single
  Vout_Chgr: single
  Vout_Invtr: single

BusObject = Simulink.Bus()

BMS_Cmd = Simulink.Bus()
  ChargeCurrentReq: single
  BMS_State: Enum: BMS_State_Enum
  PosContactorChgrCmd: boolean
  PreChargeRelayChgrCmd: boolean
  NegContactorChgrCmd: boolean
  PosContactorInvtrCmd: boolean
  PreChargeRelayInvtrCmd: boolean
  NegContactorInvtrCmd: boolean
  Faults: Bus: Faults

BMS_Info = Simulink.Bus()
  SOC: single[3 1]
  Faults: Bus: Faults
  BMS_State: Enum: BMS_State_Enum

BMS_Sw_CodeGenConfig = Simulink.ConfigSet(StartTime="0", StopTime="2000", FixedStep="0.001", Solver="FixedStepDiscrete", ProdHWDeviceType="ARM Compatible->ARM Cortex-M", SystemTargetFile="ert.tlc", HardwareBoard="ARM Cortex-M4 (MPS2)", TargetLang="C")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